# Dynamo graph Color change in view.dyn (Dynamo 2.19.3.6394)

select_model_element = DSModelElementSelection()  # 1 picked in the model; graph input
watch = Watch(select_model_element)
red = DoubleInput(255)  # graph input
green = DoubleInput(0)  # graph input
blue = DoubleInput(0)  # graph input
byARGB = Color.ByARGB(red=red, green=green, blue=blue)
overrideColorInView = Element.OverrideColorInView(element=watch, color=byARGB)
