# Dynamo graph Delete_Rooms.dyn "Delete Rooms" (Dynamo 2.19.3.6394)

categories = Categories("OST_Rooms")  # graph input
all_elements_of_category = ElementsOfCategory(Category=categories)
delete = Element.Delete(element=all_elements_of_category)
