# Dynamo graph Set_Survey_Points_Coordinates .dyn "Set_Survey_Points_Coordinates" (Dynamo 2.19.3.6394)

select_model_element = DSModelElementSelection()  # 1 picked in the model; graph input
parameters = Element.Parameters(element=select_model_element)
code_block = CodeBlock { [8,3,4]; }
getItemAtIndex = List.GetItemAtIndex(list=parameters, index=code_block)
name = Parameter.Name(parameter=getItemAtIndex)
input_the_surevy_point_s = CodeBlock { [30,20,2]; }  # "Input the Surevy Point's coordinates (x,y,z)."
setParameterByName = Element.SetParameterByName(element=select_model_element, parameterName=name, value=input_the_surevy_point_s)
